% Simulink data dictionary Model_Vars.sldd

accelBias = [0.09 0.09 0.09]

constantsASTRA = struct(
  m=1.275,
  l=0.5,
  g=9.80145,
  rTB=0.26,
  J=[0.067 0 0; 0 0.067 0; 0 0 0.02],
  T=0.01,
  mag=[0.8660254; 0; -0.5],
  Q=[2.500008e-05 0 0 0 0 0 0 0 0 -2.5e-07 -0 -0 0 0 0 0 0 0
   0 2.500008e-05 0 0 0 0 0 0 0 -0 -2.5e-07 -0 0 0 0 0 0 0
   0 0 2.500008e-05 0 0 0 0 0 0 -0 -0 -2.5e-07 0 0 0 0 0 0
   0 0 0 2.083349e-09 0 0 6.250078e-07 0 0 0 0 0 -2.083333e-09 -0 -0 0 0 0
   0 0 0 0 2.083349e-09 0 0 6.250078e-07 0 0 0 0 -0 -2.083333e-09 -0 0 0 0
   0 0 0 0 0 2.083349e-09 0 0 6.250078e-07 0 0 0 -0 -0 -2.083333e-09 0 0 0
   0 0 0 6.250078e-07 0 0 0.0002500042 0 0 0 0 0 -1.25e-6 -0 -0 0 0 0
   0 0 0 0 6.250078e-07 0 0 0.0002500042 0 0 0 0 -0 -1.25e-6 -0 0 0 0
   0 0 0 0 0 6.250078e-07 0 0 0.0002500042 0 0 0 -0 -0 -1.25e-6 0 0 0
   -2.5e-07 -0 -0 0 0 0 0 0 0 5.0e-6 0 0 0 0 0 0 0 0
   -0 -2.5e-07 -0 0 0 0 0 0 0 0 5.0e-6 0 0 0 0 0 0 0
   -0 -0 -2.5e-07 0 0 0 0 0 0 0 0 5.0e-6 0 0 0 0 0 0
   0 0 0 -1.25e-6 -0 -0 -2.083333e-09 -0 -0 0 0 0 2.5e-5 0 0 0 0 0
   0 0 0 -0 -1.25e-6 -0 -0 -2.083333e-09 -0 0 0 0 0 2.5e-5 0 0 0 0
   0 0 0 -0 -0 -1.25e-6 -0 -0 -2.083333e-09 0 0 0 0 0 2.5e-5 0 0 0
   0 0 0 0 0 0 0 0 0 0 0 0 0 0 0 2.5e-6 0 0
   0 0 0 0 0 0 0 0 0 0 0 0 0 0 0 0 2.5e-6 0
   0 0 0 0 0 0 0 0 0 0 0 0 0 0 0 0 0 2.5e-6],
  R=[0.1 0 0 0 0 0
   0 0.1 0 0 0 0
   0 0 0.1 0 0 0
   0 0 0 0.1 0 0
   0 0 0 0 0.1 0
   0 0 0 0 0 0.1],
  MaxT=16.63306065,
  K_Att=[1.311681 -2.640367e-17 -3.004458e-16 0.16493 -5.180513e-18 -1.417562e-16 -0.6582806 1.384305e-16 1.339983e-16
   -8.681729e-16 1.311681 -9.841019e-16 -2.648187e-17 0.16493 -1.402131e-16 7.459311e-16 -0.6582806 1.208559e-15
   2.311258e-16 -2.66671e-16 4.03599 2.914803e-17 -4.812147e-17 2.059154 1.520168e-16 8.995772e-16 -1.581139])

Checkpoints = [0 0 0 3 3 0 0 0
 0 0 3 3 0 0 0 0
 0 3 3 3 3 3 0 0]

distMode = 1
dt = 0.005
dt_SIM = 0.001
gyroBias = [0.005 0.005 0.005]
HoldTimeReqs = [7 5 3 3 3 3 0 0.2]
IMU_Rate = 1000

K = [1.470249 6.079113e-16 3.35429e-16 1.780005e-18 -9.946226e-05 -7.133563e-19 1.698931e-16 -0.198962 -7.14015e-17 0.1384902 3.41134e-17 1.695942e-16
 3.47313e-15 1.470249 -2.079564e-15 9.946226e-05 -1.645091e-17 -1.419498e-17 0.198962 -5.543074e-16 9.617835e-17 3.46339e-17 0.1384902 6.91463e-16
 -6.747766e-14 5.713105e-14 1.265573e-14 -3.979402e-17 -7.457944e-18 0.004559014 7.592308e-15 9.58408e-17 11.39805 -4.249235e-15 4.352528e-15 4.867908e-15
 -5.425011e-15 -2.596143e-14 5.065571 2.448453e-17 -6.53605e-17 -5.934759e-17 -1.116608e-14 -1.218548e-16 -3.126767e-16 -3.486942e-15 2.246843e-15 3.781954]

magDistMatrix = [1.010753 0.01724347 -0.00867184; 0.0366777 1.006375 0.006852489; -0.04517694 -0.02615377 1.071568]

slBus1 = Simulink.Bus()
  m: double
  l: double
  g: double
  rTB: double
  J: double[3 3]
  T: double
  mag: double[3 1]
  Q: double[18 18]
  R: double[6 6]
  MaxT: double
  K_Att: double[3 9]

u0 = [0; 0; 12.49684875; 0]
x0 = [1; 0; 0; 0; 0; 0; 0; 0; 0; 0; 0; 0; 0; 0; 0; 0]
windMerid = 2.29163
windZonal = 4.031552